# Grasshopper definition 01_point_in_time_imagebased.gh (Grasshopper 1.0.4)
# plug-ins: Ironbug

# ---- group: context!
brep = Brep([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])
debrep = DeconstructBrep(Brep=brep)  # -> flatten(Faces), Edges, Vertices

# ----
# Room geometry except for the openings.
# Types and materials will be assigned
# based on normal direction.
# 
# These geometries are under ./scene/opaque
panel = Panel("0.55")
# Context
# Context is part of the scene that won't
# change for paramteric studies. We
# just write them to a file once and include
# them in the analysis. For multi-phase
# studies it will only be part of the scene
# for daylight matrix calculation.
# 
# If copyLocal is True the file will be copied
# to ./scene/extra
# 
# NOTE: You can always create the context
# using HBSurface similar to the rest of the
# scene. This method will save you time for
# iterative studies.
hbsurface = HoneybeePlus_HoneybeeSurface(geo=debrep.Faces)  # -> report, HBSrf; plug-in component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

# ---- group: opaque surfaces
brep_2 = Brep([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])
wires = BrepWireframe(Brep=brep_2, Density=-1)
preview = CustomPreview(Geometry=wires, Shader=ColourSwatch(SwatchColor=RGB(0, 0, 0)))
hbsurface_2 = HoneybeePlus_HoneybeeSurface(geo=brep_2)  # -> report, HBSrf; plug-in component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

# ----
crv = Curve(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)
# Use this component to create a view.
# In the next release we will add view by
# name component so you can create the
# view using the view name.
# 
# View will be created under ./view folder.
end = EndPoints(Curve=crv)  # -> Start, End
# Geometry Preparation
# Windows are added to the scene
# as normal windows. They will be grouped
# together with room geometries.
# check ./scene/glazing
brep_3 = Brep([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])
radglassmaterial = HoneybeePlus_RadianceGlassMaterial(name="g_material", tVis=panel)  # -> material; plug-in component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
# Point in time daylight simulation aka Image-based
# This is the same as image-based daylight simulation in honeybee.
# Sky
path = FilePath("C:\EnergyPlusV8-6-0\WeatherData\USA_IL_Chicago-OHare.Intl.AP.725300_TMY3.epw")
preview_2 = CustomPreview(Geometry=brep_3, Shader=ColourSwatch(SwatchColor=RGBA(65, 114, 255, 72)))
# View
importlocation = Ladybug_ImportLocation(epwFile=path)  # -> location; plug-in component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
panel_2 = Panel("1000")
panel_3 = Panel("120")
panel_4 = Panel(radglassmaterial)
# Use any of the sky components to
# generate the sky for the simulation.
# 
# Sky will be created under ./sky folder.
wea = HoneybeePlus_Wea(epwFile=path)  # -> wea; plug-in component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
hbwinsrf = HoneybeePlus_HoneybeeWindowSurface(geo=brep_3, radMat=radglassmaterial)  # -> report, HBWinSrf; plug-in component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
vec2pt = Vector2Pt(PointA=end.Start, PointB=end.End, Unitize=False)  # -> Vector, Length
climatebased = HoneybeePlus_ClimatebasedSky(wea=wea)  # -> sky; plug-in component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
ciesky = HoneybeePlus_CIEStandardSky(location=importlocation, month=6, day=21, type=0)  # -> sky; plug-in component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
view = HoneybeePlus_View(
    name="indoor_view",
    vLocation=end.Start,
    vDirection=vec2pt.Vector,
    vUpVector=Point(0, 0, 1),
    viewType=0,
    hViewAngle=45,
    vViewAngle=45,
    xResolution="2000",
    yResolution="2000")  # -> view; plug-in component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
vdisex = VectorDisplayEx(Point=end.Start, Vector=vec2pt.Vector, Colour=RGB(0, 0, 0), Width=2)
data = Data(ciesky)
hbtorad = HoneybeePlus_WriteHBObjectsToRadiance(hbObjects=hbsurface.HBSrf, folder="c:\ladybug\context", filename="context.rad", write=Toggle(True))  # -> radFile; plug-in component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
radscene = HoneybeePlus_RadianceScene(radFiles=hbtorad, copyLocal=True, overwrite=True)  # -> radScene; plug-in component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
# Recipe
imagebasedrecipe = HoneybeePlus_ImageBasedRecipe(sky=data, views=view, analysisType=2)  # -> analysisRecipe; plug-in component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
panel_5 = Panel(radscene)
# Run the simulation
panel_6 = Panel(imagebasedrecipe)
data_2 = Data(flatten([hbsurface_2.HBSrf, hbwinsrf.HBWinSrf]))
# Set write to True to save the files to
# the project folder. This gives you the
# option to check the files before running
# the simulation.
# 
# Once ready also set run to True and the
# component will run the study. The output
# will be the analysis grids or an image
# collection based on the analysis type.
# 
# Results will be stored under ./result
runradiance = HoneybeePlus_RunRadianceAnalysis(
    analysisRecipe=imagebasedrecipe,
    HBObjects=data_2,
    radScene=radscene,
    folder="c:\ladybug",
    name="honeybee004",
    write=Toggle(False),
    run=Toggle(False))  # -> report, legendPar, outputs; plug-in component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
panel_7 = Panel(runradiance.report)
hdr_gif = Honeybee_ConvertHDRToGIF(adjustExposure=False)  # -> GIFFilePath; plug-in component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
# Post process
# Result visualization
sethdrexposure = Honeybee_SetExposureForHDR(HDRFilePath=runradiance.outputs, exposure=Slider(0.5, range=0..1), render=Toggle(True))  # -> outputFilePath; plug-in component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
ladybug = Ladybug_Ladybug()  # -> Vviiiiiiiiiizzz; plug-in component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
honeybee = Honeybee_Honeybee()  # -> Vviiiiiiiiiizzz; plug-in component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
viewer = Ladybug_ImageViewer(ImagePath_=sethdrexposure, _scale_=Slider(1, range=0..10), DisableClickable=False, SaveImgWithCoords=False, scale=1)  # -> ImagePath, Colors, GIF
