# Grasshopper definition 03_annual_daylight_analysis.gh (Grasshopper 0.9.76)
# plug-ins: Python Interpreter

path = FilePath("C:\EnergyPlusV8-6-0\WeatherData\USA_IL_Chicago-OHare.Intl.AP.725300_TMY3.epw")
brep = Brep([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])
panel = Panel("""9
10
11
12
13
14
15""")
number_slider = Slider(2, range=0..10)
wires = BrepWireframe(Brep=brep, Density=-1)
panel_2 = Panel(path)
importlocation = Ladybug_ImportLocation(epwFile=path)  # -> location; plug-in component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
gentestpts = Honeybee_GenerateTestPoints(testGeometry=brep, gridSize="1", distBaseSrf=Slider(0.762, range=0..1), moveTestMesh=True)  # -> readMe, simplify(testPoints), simplify(ptsVectors), simplify(facesArea), simplify(mesh); plug-in component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
wea = HoneybeePlus_Wea(epwFile=path)  # -> wea; plug-in component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
doy_hoy = Ladybug_DOY_HOY(days=1, months="6", hours=panel)  # -> HOY, DOY, date; plug-in component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

# ---- group: single skylight
brep_2 = Brep(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)

# ---- group: south_skylight
brep_3 = Brep(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)

# ---- group: north_skylight
brep_4 = Brep(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)

# ---- group: opaque surfaces
brep_5 = Brep([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])
wires_2 = BrepWireframe(Brep=brep_5, Density=-1)
preview = CustomPreview(Geometry=wires_2, Shader=ColourSwatch(SwatchColor=RGB(0, 0, 0)))
hbsurface = HoneybeePlus_HoneybeeSurface(geo=brep_5)  # -> report, HBSrf; plug-in component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

# ----
concat = Concatenate(FragmentA="g_material_", FragmentB="0.55")

# ---- group: side window with two states / materials
brep_6 = Brep(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)

# ---- group: side windows. they are static and will be grouped together as window surfaces
brep_7 = Brep([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])

# ----
preview_2 = CustomPreview(Geometry=[brep_4, brep_3, brep_2], Shader=ColourSwatch(SwatchColor=RGBA(221, 128, 94, 72)))

# ---- group: context!
brep_8 = Brep([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])
debrep = DeconstructBrep(Brep=brep_8)  # -> flatten(Faces), Edges, Vertices
hbsurface_2 = HoneybeePlus_HoneybeeSurface(geo=debrep.Faces)  # -> report, HBSrf; plug-in component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

# ----
panel_3 = Panel("""single_skylight
south_skylight
north_skylight""")
panel_4 = Panel("""room_a
room_b""")
radpargridbased = HoneybeePlus_RadianceParametersGridBased(complexity=0, recipeType=Slider(1, range=0..1))  # -> report, radPar, vmtxPar, dmtxPar, smtxPar; plug-in component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
panel_5 = Panel(importlocation)
pt = Point(gentestpts.testPoints)
radglassmaterial = HoneybeePlus_RadianceGlassMaterial(name=concat, tVis="0.55")  # -> material; plug-in component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
merge = Merge(Data1=brep_2, Data2=brep_3, Data3=brep_4)
preview_3 = CustomPreview(Geometry=brep_7, Shader=ColourSwatch(SwatchColor=RGBA(121, 230, 94, 72)))
hbsurface_3 = HoneybeePlus_HoneybeeSurface()  # -> report, HBSrf; plug-in component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
graft = GraftTree(Tree=panel_4, IncludeEmptyLists=True, IncludeNullItems=True)
panel_6 = Panel(radpargridbased.dmtxPar)
analysisgrid = HoneybeePlus_AnalysisGrid(name=graft, testPoints=gentestpts.testPoints, ptsVectors=gentestpts.ptsVectors)  # -> analysisGrid; plug-in component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
hbwinsrf = HoneybeePlus_HoneybeeWindowSurface(geo=merge, names=panel_3)  # -> report, HBWinSrf; plug-in component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
hbwinsrf_2 = HoneybeePlus_HoneybeeWindowSurface(geo=brep_6, names="north_facing", radMat=radglassmaterial)  # -> report, HBWinSrf; plug-in component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
hbwinsrf_3 = HoneybeePlus_HoneybeeWindowSurface(geo=brep_7)  # -> report, HBWinSrf; plug-in component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
skymatrix = HoneybeePlus_SkyMatrix(north=0, wea=wea, density=1)  # -> skymtx; plug-in component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
skyvector = HoneybeePlus_SkyVector(north=0, wea=wea, month=6, day=21, hour="10")  # -> skyVec; plug-in component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
radpargridbased_2 = HoneybeePlus_RadianceParametersGridBased(complexity=0, recipeType=Slider(1, range=0..1))  # -> report, radPar, vmtxPar, dmtxPar, smtxPar; plug-in component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
radparimagebased = HoneybeePlus_RadianceParametersImageBased(complexity=0)  # -> report, radPar, vmtxPar, dmtxPar, smtxPar; plug-in component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
flatten = FlattenTree(Tree=analysisgrid, Path="{0}")
panel_7 = Panel(radpargridbased_2.dmtxPar)
dcoeffgbrecipe = HoneybeePlus_DCGridBasedDaylightRecipe(skymtx=skymatrix, analysisGrids=flatten, analysisType=0, dmtxPar=radpargridbased_2.dmtxPar, reuseDmtx=Toggle(True))  # -> analysisRecipe; plug-in component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
data = Data(flatten([hbsurface.HBSrf, hbsurface_2.HBSrf, hbwinsrf_3.HBWinSrf, hbwinsrf_2.HBWinSrf, hbwinsrf.HBWinSrf]))
panel_8 = Panel(dcoeffgbrecipe)
toggle = BooleanToggle(True)
runradiance = HoneybeePlus_RunRadianceAnalysis(analysisRecipe=dcoeffgbrecipe, HBObjects=data, folder="c:\ladybug", name="annual_analysis", write=toggle, run=toggle)  # -> readMe, legendPar, results; plug-in component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
panel_9 = Panel(runradiance.readMe)
item = ListItem(List=runradiance.results, Index=0, Wrap=True)
sensor = HoneybeePlus_SensorFromAnalysisGrid(analysisGrid=runradiance.results, index=0)  # -> position, sensor; plug-in component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
python = PythonScript(x=item)  # -> out, a
# ---------- python: Python ----------
a = x[0]
# ---------- end python ----------
python_2 = PythonScript(x=python.a)  # -> out, a
# ---------- python_2: Python ----------
a = x.values(None, 'scene', 'default')
# ---------- end python_2 ----------
panel_10 = Panel("""(0,)
(-1,)""")
item_2 = ListItem(List=sensor.sensor, Index=Slider(0, range=0..1), Wrap=True)
larger = LargerThan(FirstNumber=python_2.a, SecondNumber=300)  # -> LargerThan, OrEqualTo
number_slider_2 = Slider(100, range=0..100)
dynblindschd = HoneybeePlus_DynamicBlindsSchedule(sensor=item_2, blindCombs=panel_10)  # -> report, blindStates, blindStIndex, illumTotal, illumDirect, success; plug-in component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
ma = MassAddition(Input=larger.OrEqualTo)  # -> Result, PartialResults
panel_11 = Panel(python_2.a)
lng = ListLength(List=python_2.a)
division = Division(A=ma.Result, B=lng)
panel_12 = Panel(division)
number_slider_3 = Slider(16, range=9..18)
number_slider_4 = Slider(10, range=0..10)
occschduleweek = HoneybeePlus_OccupancyScheduleFromWeek(defValue=1)  # -> schedule, values; plug-in component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
number_slider_5 = Slider(55, range=0..100)
number_slider_6 = Slider(50, range=0..100)
panel_13 = Panel("(-1, -1, -1, -1, 0)")
item_3 = ListItem(Index=0, Wrap=True)
occschdule = HoneybeePlus_OccupancySchedule()  # -> schedule; plug-in component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
ase = HoneybeePlus_AnnualSolarExposure(analysisGrid=runradiance.results, threshold=1000, targetHrs=250, targetArea=10)  # -> report, success, ASE, perArea, prblmPts, prblmHrs; plug-in component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
sda = HoneybeePlus_SpatialDaylightAutonomy(
    analysisGrid=runradiance.results,
    blindStates=dynblindschd.blindStates,
    occSchedule=occschduleweek.schedule,
    threshold=300,
    targetArea="90")  # -> report, sDA, prblmHrs; plug-in component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
annualmetrics = HoneybeePlus_AnnualDaylightMetrics(analysisGrid=runradiance.results, blindStates=dynblindschd.blindStates, occSchedule=occschduleweek.schedule)  # -> report, DA, CDA, UDI, UDILess, UDIMore; plug-in component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
doy_hoy_2 = Ladybug_DOY_HOY(days=1, months=number_slider_4, hours=number_slider_3)  # -> HOY, DOY, date; plug-in component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
lng_2 = ListLength(List=sda.prblmHrs)
number_slider_7 = Slider(2, range=0..10)
item_4 = ListItem(List=sda.prblmHrs, Index=0, Wrap=True)
division_2 = Division(A=lng_2, B="22")
panel_14 = Panel(sda.sDA)
panel_15 = Panel(item_4)
maxvalue = HoneybeePlus_MaximumValue(analysisGrid=runradiance.results)  # -> values; plug-in component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

# ---- group: hourly values
hourlyvalues = HoneybeePlus_HourlyValues(analysisGrid=runradiance.results, hoy=doy_hoy_2.HOY)  # -> report, values; plug-in component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

# ----
cumvalue = HoneybeePlus_CumulativeValue(analysisGrid=runradiance.results)  # -> report, values; plug-in component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
ladybug = Ladybug_Ladybug()  # -> Vviiiiiiiiiizzz; plug-in component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
senhourlyvalues = HoneybeePlus_SensorHourlyValues(sensor=item_2, mode=Slider(2, range=0..2))  # -> report, values; plug-in component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

# ---- group: temporary solution until ladybug[+] is ready!
python_3 = PythonScript(x=runradiance.legendPar)  # -> a, b, c, d
# ---------- python_3: Python ----------
from System.Drawing import Color
if x:
    a = x.domain[0]
    b = x.domain[-1]
    c = 11
    d = (Color.FromArgb(1, c.r, c.g, c.b) for c in x.colors)
# ---------- end python_3 ----------

# ----
panel_16 = Panel(maxvalue)
ase_2 = HoneybeePlus_AnnualSolarExposure(threshold=1000, targetHrs=250, targetArea=10)  # -> report, success, perArea, prblmPts, prblmHrs; plug-in component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
sunpath = Ladybug_SunPath(
    location=importlocation,
    hour=number_slider_3,
    day=21,
    month=number_slider_4,
    timeStep=1,
    sunPathScale="0.25",
    dailyOrAnnualSunPath=True)  # -> readMe, sunVectors, sunAltitudes, sunAzimuths, port, sunSpheresMesh, sunPathCrvs, compassCrvs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; plug-in component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
legendpar = Ladybug_LegendParameters(lowBound=python_3.a, highBound="250", numSegments=python_3.c, customColors=flatten(python_3.d))  # -> legendPar; plug-in component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
mjoin = MeshJoin(Meshes=flatten(gentestpts.mesh))
flatten_2 = FlattenTree(Tree=ase.ASE, Path="{0}")
panel_17 = Panel(sunpath.sunAltitudes)
recolormesh = Ladybug_RecolorMesh(
    analysisResult=flatten_2,
    inputMesh=mjoin,
    legendPar=legendpar,
    analysisTitle="Annual Solar Exposure",
    legendTitle="hour")  # -> readMe, newMesh, newLegend, legendBasePt, meshColors, legendColors; plug-in component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
ladybug_2 = Ladybug_Ladybug()  # -> Vviiiiiiiiiizzz; plug-in component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
