# Grasshopper definition 03_solaraccess_gridbased.gh (Grasshopper 1.0.7)

txt = Text("https://www.energyplus.net/weather-download/north_and_central_america_wmo_region_4/USA/IL/USA_IL_Chicago-OHare.725300_TMY2/all")
# Solar access aka sunlight hours simulation
# In honeybee[+], we renamed sunlight hours component to "solar access"
# to follow other available standards. We hope this note clarifies this potential
# sort of confusion.
downloadepw = LBDownloadWeather(weather_URL=txt)  # -> epw_file, stat_file, ddy_file; plug-in component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
series = Series(Start="1", Step=1, Count="12")
series_2 = Series(Start=0, Step=1, Count="24")
path = FilePath(downloadepw.epw_file)
graft = GraftTree(Tree=series, IncludeEmptyLists=True, IncludeNullItems=True)
importloc = LBImportLocation(epw_file=path)  # -> location; plug-in component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
hoy = LBCalculateHOY(month=graft, hour=series_2)  # -> flatten(hoy), flatten(doy), flatten(date); plug-in component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
flatten = FlattenTree(Tree=hoy.hoy, Path="{0}")
# Geometry Preparation
number_slider = Slider(0.762, range=0..1)
# Generate test points
# You can use any other grasshopper
# components to generate these points.
panel = Panel("1")
# Room geometry except for the openings.
# Types and materials will be assigned
# based on normal direction.
# 
# These geometries are under ./scene/opaque
panel_2 = Panel("wall")
sunpath = LBSunPath(location=importloc, hoys=flatten, scale=Slider(0.2, range=0..1), annual=True)  # -> report, vectors, altitudes, azimuths, hoys, sun_pts, analemma, daily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; plug-in component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
radglassmat = HoneybeePlus_RadianceGlassMaterial(name="g_material", t_vis=".6")  # -> material; plug-in component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
brep = Brep(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)
radopaquemat = HoneybeePlus_RadianceOpaqueMaterial(name=panel_2, reflect=".55", spec=0, rough=0)  # -> material; plug-in component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
brep_2 = Brep(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)
panel_3 = Panel(radglassmat)
wires = BrepWireframe(Brep=brep, Density=-1)
genpts = LBGeneratePointGrid(geometry=brep, grid_size=panel, dist_surface=number_slider)  # -> points, vectors, face_areas, mesh; plug-in component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
preview = CustomPreview(Geometry=brep_2, Shader=ColourSwatch(SwatchColor=RGBA(211, 208, 255, 64)))
# Side window is added to the scene
# as normal windows. They will be grouped
# together with room geometries.
# check ./scene/glazing
wires_2 = BrepWireframe(Brep=brep_2, Density=-1)
brep_3 = Brep([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])
brep_4 = Brep(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)
panel_4 = Panel(radopaquemat)
wires_3 = BrepWireframe(Brep=brep_3, Density=-1)
debrep = DeconstructBrep(Brep=brep_4)  # -> Faces, Edges, Vertices
hbwinsrf = HoneybeePlus_HoneybeeWindowSurface(geo=brep_2, names="glass_wall", rad_mat=radglassmat)  # -> report, HB_win_srf; plug-in component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
hbsurface = HoneybeePlus_HoneybeeSurface(geo=debrep.Faces)  # -> report, HB_srf; plug-in component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
hbsurface_2 = HoneybeePlus_HoneybeeSurface(geo=brep_3, rad_mat=radopaquemat)  # -> report, HB_srf; plug-in component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
# Analysis Grid
analysisgrid = HoneybeePlus_AnalysisGrid(name="test_room", test_points=genpts.points, pts_vectors=genpts.vectors)  # -> analysis_grid; plug-in component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
# Recipe
solaraccessrecipe = HoneybeePlus_SolarAccessRecipe(sun_vectors=sunpath.vectors, hoys=sunpath.hoys, analysis_grids=analysisgrid)  # -> analysis_recipe; plug-in component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
data = Data(flatten([hbsurface.HB_srf, hbsurface_2.HB_srf, hbwinsrf.HB_win_srf]))
panel_5 = Panel(solaraccessrecipe)
# Run the simulation
# Set write to True to save the files to
# the project folder. This gives you the
# option to check the files before running
# the simulation.
# 
# Once ready also set run to True and the
# component will run the study. The output
# will be the analysis grids or an image
# collection based on the analysis type.
# 
# Results will be stored under ./result
runradiance = HoneybeePlus_RunRadianceAnalysis(
    analysis_recipe=solaraccessrecipe,
    HB_objects=data,
    folder="c:\ladybug",
    name="hbp_sample_files",
    write=Toggle(False),
    run=Toggle(False))  # -> report, legend_par, outputs; plug-in component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
panel_6 = Panel(runradiance.report)
item = ListItem(List=sunpath.hoys, Index=Slider(5, range=0..20), Wrap=True)
# Post process
# Result visualization
# You can get the cumulative values for
# all the hours or check the results for each
# hour separately.
# Cumulative results
cumvalue = HoneybeePlus_CumulativeValue(analysis_grid=runradiance.outputs)  # -> report, values; plug-in component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
# Hourly results
hourlyvalues = HoneybeePlus_HourlyValues(analysis_grid=runradiance.outputs, hoy=item)  # -> report, values; plug-in component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
python = GhPythonScript(hoy=item)  # -> out
# ---------- python: Python ----------
from ladybug.dt import DateTime


if _hoy:
    dt = DateTime.from_hoy(_hoy)
    print(dt)
# ---------- end python ----------
panel_7 = Panel(python)
num = Number(cumvalue.values)
heatmap = LBSpatialHeatmap(values=num, mesh=genpts.mesh, legend_par=runradiance.legend_par, legend_title="hours", global_title="solar access")  # -> mesh, legend, title, colors, legend_par; plug-in component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
