# Grasshopper definition 07_daylight_coefficient_imagebased.gh (Grasshopper 0.9.76)
# plug-ins: Python Interpreter, Ironbug

path = FilePath("C:\EnergyPlusV8-6-0\WeatherData\USA_IL_Chicago-OHare.Intl.AP.725300_TMY3.epw")
# Daylight coefficient image-based simulation
# A sample file on how to use daylight coefficient recipe. Daylight coefficient recipe in honeybee
# is implemented using radiance utilities and doesn't use Daysim.
# 
# You can generate images for multiple hours once calculate the daylight coeff for each view.
panel = Panel(path)
panel_2 = Panel("""9
10
11
12
13
14
15""")
# Sky Matrix
wea = HoneybeePlus_Wea(epwFile=path)  # -> wea; plug-in component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

# ---- group: side windows. they are static and will be grouped together as window surfaces
brep = Brep(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)

# ---- group: single skylight
# Add glazing surfaces to the scene. Note
# that we're grouping the skylight and a side
# window.
# 
# These glazing will be written to  ./scene/glazing
brep_2 = Brep(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)

# ---- group: opaque surfaces
brep_3 = Brep([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])
wires = BrepWireframe(Brep=brep_3, Density=-1)
preview = CustomPreview(Geometry=wires, Shader=ColourSwatch(SwatchColor=RGB(0, 0, 0)))
hbsurface = HoneybeePlus_HoneybeeSurface(geo=brep_3)  # -> report, HBSrf; plug-in component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

# ---- group: context!
# Geometry Preparation
# Add context surfaces.
# These geometries are under ./scene/opaque
# Room geometry except for the openings.
# Types and materials will be assigned
# based on normal direction.
# 
# These geometries are under ./scene/opaque
brep_4 = Brep([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])
debrep = DeconstructBrep(Brep=brep_4)  # -> flatten(Faces), Edges, Vertices
hbsurface_2 = HoneybeePlus_HoneybeeSurface(geo=debrep.Faces)  # -> report, HBSrf; plug-in component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

# ----
concat = Concatenate(FragmentA="g_material_", FragmentB="0.55")
hoy = LadybugPlus_CalculateHOY(month="6", day=21, hour=panel_2, minute=0)  # -> hoy, doy, date; plug-in component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

# ---- group: side window with two states / materials
brep_5 = Brep(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)

# ----
preview_2 = CustomPreview(Geometry=[brep, brep_2], Shader=ColourSwatch(SwatchColor=RGBA(121, 230, 94, 72)))
radglassmaterial = HoneybeePlus_RadianceGlassMaterial(name=concat, tVis="0.55")  # -> material; plug-in component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
pt = Point(Point(1, 1, 2))
pt_2 = Point(Point(2.761757981, 3.184085208, 2.438065029))
# Window Groups
# Use WindowGroup component to create
# static or dynamic window groups. In case
# of multi-phase recipes windows in each
# windowgroup should have the same direction.
# 
# Each window group will be written to  ./scene/wgroup
panel_3 = Panel("north_facing")
# Glazing Surfaces
hbwinsrf = HoneybeePlus_HoneybeeWindowSurface(geo=[brep_2, brep])  # -> report, HBWinSrf; plug-in component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
ln = Line(StartPoint=pt, EndPoint=pt_2)
# We're using hoys input for subannual simulation.
# Sky will be created under ./sky folder.
skymatrix = HoneybeePlus_SkyMatrix(north=0, wea=wea, density=1, hoys=hoy.hoy)  # -> skymtx; plug-in component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
vec = Vector(ln)
hbwingroup = HoneybeePlus_HoneybeeWindowGroup(geo=brep_5, name=panel_3, radMat=radglassmaterial)  # -> report, HBWinGroup; plug-in component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
# View
view = HoneybeePlus_View(
    name="inside_NE",
    vLocation=pt,
    vDirection=vec,
    vUpVector=Point(0, 0, 1),
    viewType=0,
    hViewAngle="60",
    vViewAngle=45,
    xResolution="400",
    yResolution="400")  # -> view; plug-in component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
data = Data(flatten([hbsurface.HBSrf, hbsurface_2.HBSrf, hbwinsrf.HBWinSrf, hbwingroup.HBWinGroup]))
# Recipe
dcoeffibrecipe = HoneybeePlus_DCImageBasedDaylightRecipe(skymtx=skymatrix, views=view, analysisType=2, reuseDmtx=False)  # -> analysisRecipe; plug-in component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
# Run the simulation
# This will take around an hour to run
# for the first time!
# 
# Once the analysis is over you can use
# the output to generate hourly images
# for each hour is a couple of seconds.
# 
# In the next few releases you should be
# able to run the analysis in parallel.
runradiance = HoneybeePlus_RunRadianceAnalysis(
    analysisRecipe=dcoeffibrecipe,
    HBObjects=data,
    folder="c:\ladybug",
    name="honeybee_005",
    write=Toggle(False),
    run=Toggle(False))  # -> report, legendPar, outputs; plug-in component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
item = ListItem(List=hoy.hoy, Index=Slider(1, range=0..7), Wrap=True)

# ---- group: try to remove one of the windows
panel_4 = Panel("(0, -1)")

# ----
panel_5 = Panel(runradiance.report)
genimages = HoneybeePlus_GenerateImages(imgCollection=runradiance.outputs, hoys=item)  # -> report, images; plug-in component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
panel_6 = Panel(genimages.report)
sethdrexposure = Honeybee_SetExposureForHDR(HDRFilePath=genimages.images, exposure=Slider(0.6, range=0..1), render=Toggle(True))  # -> outputFilePath; plug-in component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
viewer = Ladybug_ImageViewer(ImagePath_=sethdrexposure, _scale_=1, DisableClickable=False, SaveImgWithCoords=False, scale=1)  # -> ImagePath, Colors, GIF
ladybug = Ladybug_Ladybug()  # -> Vviiiiiiiiiizzz; plug-in component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
honeybee = Honeybee_Honeybee()  # -> Vviiiiiiiiiizzz; plug-in component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
panel_7 = Panel(viewer.GIF)
